# Grasshopper definition 01_0_outdoor_airflow.gh (Grasshopper 1.0.7)

panel = Panel("""20
60
20""")
panel_2 = Panel("""0.5
0.5""")
panel_3 = Panel("""0.1
0.3
0.6""")
panel_4 = Panel("""70
30""")
seggrading = Butterfly_SegmentGrading(percentage_length=panel_3, percentage_cells=panel, expansion_ratio=1)  # -> segment_grading; plug-in component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
seggrading_2 = Butterfly_SegmentGrading(percentage_length=panel_2, percentage_cells=panel_4, expansion_ratio=1)  # -> segment_grading; plug-in component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
multigrading = Butterfly_MultiGrading(segment_gradings=flatten(seggrading_2))  # -> grading; plug-in component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
multigrading_2 = Butterfly_MultiGrading(segment_gradings=flatten(seggrading))  # -> grading; plug-in component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
gradxyz = Butterfly_GradingXYZ(x_grading=1, y_grading=multigrading_2, z_grading=multigrading)  # -> grad_xyz; plug-in component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

brep = Brep([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])
# This file is set up in meters. If you're using a different units make sure to scale the input geometries.
wires = BrepWireframe(Brep=brep, Density=-1)

bbox = BoundingBox(Content=brep, Plane=PlaneXY(0, 0, 0), UnionBox=True)  # -> Box, Box_2
volume = Volume(Geometry=bbox.Box_2)  # -> Volume, Centroid
number_slider = Slider(1.5, range=0..10)
project = Project(Geometry=volume.Centroid, Plane=PlaneXY(0, 0, 0))  # -> Geometry, Transform
inoutrefmode = Butterfly_LocationRefinementMode(mode=0, level="3.0")  # -> location_ref_mode; plug-in component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
scale_nu = ScaleNU(Geometry=bbox.Box_2, Plane=project.Geometry, ScaleX=number_slider, ScaleY=number_slider, ScaleZ=number_slider)  # -> Geometry, Transform
refinementregion = Butterfly_RefinementRegion(name="around_buildings_area", geo=flatten(scale_nu.Geometry), ref_mode=inoutrefmode)  # -> report, ref_region; plug-in component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

# ----
# 0. BUTTERFLY GEOMETRIES
wall = Butterfly_WallBoundary()  # -> wall_boundary; plug-in component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
jagged = SettingsSpeed()
createbfgeometry = Butterfly_CreateButterflyGeometry(name="buildings", geo=flatten(brep), boundary=wall, refine_levels="(4, 4)", mesh_set=jagged)  # -> report, BF_geo; plug-in component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

tunnelparams = Butterfly_WindTunnelParameters(windward_x=3, top_x=5, sides_x=5, leeward_x=15)  # -> report, tunnel_params; plug-in component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
windvector = Butterfly_WindVector(wind_speed="6", wind_direction=Point(0, 1, 0))  # -> wind_vector; plug-in component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
# 1. WIND TUNNEL
createcasefromtunnel = Butterfly_CreateCaseFromTunnel(
    name="outdoor_airflow",
    BF_geo=flatten(createbfgeometry.BF_geo),
    ref_regions=refinementregion.ref_region,
    wind_vector=windvector,
    ref_wind_height=10,
    landscape=6,
    tunnel_params=tunnelparams.tunnel_params,
    run=Toggle(False))  # -> report, block_pts, wind_tunnel, case; plug-in component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
toggle = BooleanToggle(False)
# 2.0. Grading
wtgrading = Butterfly_windTunnelGrading(wind_tunnel=createcasefromtunnel.wind_tunnel, cell_size=1, cell_to_cell_ratio=1.2, wake_offset=2, height_offset=5)  # -> report, grad_xyz, cell_count_xyz, cell_count_tot, preview; plug-in component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

# ---- group: turn off the sanp to get the hard edges correctly
toggle_2 = BooleanToggle(False)

# ----
larger_than_90_to_get_the_hard_edges = Panel("castellatedMeshControls  {resolveFeatureAngle 95;}")
snappyhexmeshdict = Butterfly_snappyHexMeshDict(
    castellated_mesh=True,
    snap=toggle_2,
    add_layers=False,
    n_cells_btwn_levels=3,
    max_global_cells=2000000,
    srf_feature_level=Slider(3, range=0..10),
    expansion_ratio=1.1,
    final_layer_thickness=0.7,
    min_thickness=0.1,
    n_layer_iter=50,
    additional_par=larger_than_90_to_get_the_hard_edges)  # -> snappy_hex_mesh_dict; plug-in component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

# ----
# PURGE CASE
purgecase = Butterfly_purgeCase(case=createcasefromtunnel.case, block_mesh=toggle, snappy_hex_mesh=toggle, results=toggle, post_processing=toggle)  # -> report; plug-in component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

brep_2 = Brep([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])
item = ListItem(List=brep_2, Index=0, Wrap=True)
gentestpts = Honeybee_GenerateTestPoints(testGeometry=item, gridSize="1", distBaseSrf="0.01", moveTestMesh=Toggle(False))  # -> readMe, simplify(testPoints), simplify(ptsVectors), simplify(facesArea), simplify(mesh); plug-in component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
flatten = FlattenTree(Tree=gentestpts.mesh, Path="{0}")
flatten_2 = FlattenTree(Tree=gentestpts.testPoints, Path="{0}")

panel_5 = Panel(wtgrading.report)
panel_6 = Panel(wtgrading.grad_xyz)
panel_7 = Panel(createcasefromtunnel.report)
panel_8 = Panel(purgecase)
# 2.1. BLOCKMESH
blockmesh = Butterfly_blockMesh(
    case=createcasefromtunnel.case,
    grad_xyz=wtgrading.grad_xyz,
    cell_count=wtgrading.cell_count_xyz,
    overwrite=True,
    write=Toggle(False),
    run=Toggle(False))  # -> report, case; plug-in component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
panel_9 = Panel("""p
U""")
controldict = Butterfly_controlDict(start_time=0, end_time="600", write_interval=100, write_compression=False, purge_write=0)  # -> control_dict; plug-in component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
panel_10 = Panel("(2, 4)")
relaxtionfactors = Butterfly_relaxtionFactors(quantities="U", values="0.0001")  # -> relaxation_factors; plug-in component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
probes = Butterfly_probes(points=flatten_2, fields=panel_9)  # -> probes; plug-in component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
residualcontrol = Butterfly_residualControl(quantities="U", values="0.0001")  # -> residual_control; plug-in component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
# 2. MESHING
# 2.2. SNAPPYHEXMESH
snappyhexmesh = Butterfly_snappyHexMesh(case=blockmesh.case, snappy_hex_mesh_dict=snappyhexmeshdict, write=Toggle(False), run=Toggle(False))  # -> report, case; plug-in component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
panel_11 = Panel(snappyhexmesh.report)
decomposepardict_scotch = Butterfly_decomposeParDictScotch(num_of_cpus="4")  # -> decompose_par_dict; plug-in component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
solutionparams = Butterfly_SolutionParameters(control_dict=controldict, probes=probes)  # -> solution_par; plug-in component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
steadyincomp = Butterfly_SteadyIncompressibleRecipe()  # -> report, recipe; plug-in component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
# VISUALIZE MESH
loadmesh = Butterfly_LoadMesh(case=blockmesh.case, inner_mesh=False, load=Toggle(False))  # -> mesh; plug-in component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
# Solution should be converged in 561 iterations with default settings.
panel_12 = Panel("5")
# 3. SOLUTION
solution = Butterfly_Solution(
    case=snappyhexmesh.case,
    recipe=steadyincomp.recipe,
    solution_par=solutionparams,
    interval=panel_12,
    write=Toggle(False),
    run=Toggle(False))  # -> report, solution, is_running, timestep, residual_fields, residual_values, log_files; plug-in component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
panel_13 = Panel(solution.report)
panel_14 = Panel(solution.residual_values)
loadprobesvalue = Butterfly_LoadProbesValue(solution=solution.solution, field="p")  # -> values; plug-in component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
loadprobesvalue_2 = Butterfly_LoadProbesValue(solution=solution.solution, field="U")  # -> values; plug-in component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

rec = Rectangle({Plane=PlaneXY(1, -6, 0), Size=Domain2(u=0..15, v=0..5)})
# PLOT RESIDUALS
plotresiduals = Butterfly_PlotResiduals(solution=solution.solution, rect=rec, target_res=0.0001, port=0.1, method=0, load=Toggle(False))  # -> report, time_range, curves, port, residual_line, colors; plug-in component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
preview = CustomPreview(Geometry=plotresiduals.curves, Shader=plotresiduals.colors)

# ---- group: points
pt = Point(flatten_2)

# ---- group: vectors
vec = Vector(loadprobesvalue_2)

# ----
vlen = VectorLength(Vector=vec)
bnd = Bounds(Numbers=vlen)
dedomain = DeconstructDomain(Domain=bnd)  # -> Start, End
gradient = Gradient(
    LowerLimit=dedomain.End,
    UpperLimit=dedomain.Start,
    Parameter=vlen,
    stops=[0: RGB(234, 38, 0), 0.25: RGB(234, 126, 0), 0.5: RGB(254, 244, 84), 0.75: RGB(173, 203, 249), 1: RGB(75, 107, 169)])
scale = Slider(0.69, range=0..1)
multiplication = Multiplication(A=vec, B=scale)
vdisex = VectorDisplayEx(Point=pt, Vector=multiplication, Colour=gradient, Width=Slider(2, range=0..5))

gradientlibrary = Ladybug_GradientLibrary(gradIndex="7")  # -> customColors; plug-in component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
# 4. RESULT VISUALIZATION
mjoin = MeshJoin(Meshes=flatten)
legendpar = Ladybug_LegendParameters(customColors=flatten(gradientlibrary))  # -> legendPar; plug-in component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
recolormesh = Ladybug_RecolorMesh(analysisResult=loadprobesvalue, inputMesh=mjoin, legendPar=legendpar, analysisTitle="Pressure.", legendTitle="Pa.")  # -> readMe, newMesh, newLegend, legendBasePt, meshColors, legendColors; plug-in component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
ladybug = Ladybug_Ladybug()  # -> Vviiiiiiiiiizzz; plug-in component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
faceb = FaceBoundaries(Mesh=recolormesh.newMesh)
mesh = Mesh(recolormesh.newLegend)
preview_2 = CustomPreview(Geometry=faceb, Shader=recolormesh.meshColors)

panel_15 = Panel(plotresiduals.report)
